# Grasshopper definition git250206_COMAU joints robots pdl code.gh (Grasshopper 1.0.7)
# plug-ins: Robots

# ----
# no spaces
# scaned tool
panel = Panel("-5.205")
construct_point = ConstructPoint(XCoordinate="-286.893", YCoordinate=panel, ZCoordinate="382.525")
geometry = Geometry([<mesh referenced from the Rhino model> x2, <brep referenced from the Rhino model> x2])
mesh = Mesh(geometry)
mesh_join = MeshJoin(Meshes=mesh)
weld_mesh = WeldMesh(Mesh=mesh_join, Angle=3.141592654)
tool_name = Panel("welding_gun")
pl = ConstructPlane(Origin=construct_point, XAxis="-1,0,0", YAxis=Vector(0, 1, 0))
weight = Panel("2.0")
tool = CreateTool(Name=tool_name, TCP=pl, Weight=weight, Mesh=weld_mesh)  # -> Tool, TCP

list = RobotsLibrary(
    {"AA-KR60", "AA-KR30", "AA-KR60_KR30", "AARCH IRB120", "AARCH IRB6620", "AARCH IRB120", "AARCH IRB6620", "AAU-Utzon-UR10", "AAU-Utzon-UR10", "Automata"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}, selected="TUD_COMAU_NM16",
    Type=0)
load_robot_system = LoadRobotSystem(Name=list, Base=PlaneXY(0, 0, 0))
merge = Merge(
    Data1=Slider(0, range=-360..360),
    Data2=Slider(-85, range=-360..360),
    Data3=Slider(121, range=-360..360),
    Data4=Slider(0, range=-360..360),
    Data5=Slider(56, range=-360..360),
    Data6=Slider(7, range=-360..360))
degrees_to_radians = DegreesToRadians(Degrees=merge, RobotSystem=load_robot_system, MechanicalGroup=0)

merge_2 = Merge(
    Data1=Slider(0, range=-360..360),
    Data2=Slider(-76, range=-360..360),
    Data3=Slider(112, range=-360..360),
    Data4=Slider(0, range=-360..360),
    Data5=Slider(56, range=-360..360),
    Data6=Slider(-90, range=-360..360))

# ----
# PLANES INPUT
data = Data(Tree({0;0;0;0}: [PlaneXY(2316.242571, 79.25848644, 271.9743768), PlaneXY(2316.242571, 79.25848644, 171.9743768), PlaneXY(2316.801762, 78.45987798, 172.0148934), PlaneXY(2317.360658, 77.66126162, 172.0591434), PlaneXY(2317.919112, 76.86228719, 172.1025049), PlaneXY(2318.477345, 76.06315241, 172.1457494)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], {0;0;1;0}: [PlaneXY(2279.152046, 51.61676215, 274.0164345), PlaneXY(2279.152046, 51.61676215, 174.0164345), PlaneXY(2279.79343, 50.75435351, 174.0964485), PlaneXY(2280.436288, 49.89297239, 174.175694), PlaneXY(2281.078035, 49.03081444, 174.2554986), PlaneXY(2281.720341, 48.16896696, 174.3341092)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], {0;0;2;0}: [Plane(origin=(2366.65623, -18.22008508, 306.345141), x=(0.906307787, 0, 0.4226182617), y=(0.1093816549, 0.9659258263, -0.234569716)), Plane(origin=(2366.65623, -18.22008508, 206.345141), x=(0.906307787, 0, 0.4226182617), y=(0.1093816549, 0.9659258263, -0.234569716)), Plane(origin=(2365.784804, -17.80119513, 205.6149708), x=(0.906307787, 0, 0.4226182617), y=(0.1093816549, 0.9659258263, -0.234569716)), Plane(origin=(2364.929024, -17.39438683, 204.8600115), x=(0.906307787, 0, 0.4226182617), y=(0.1093816549, 0.9659258263, -0.234569716)), Plane(origin=(2364.090355, -16.99872776, 204.0802236), x=(0.906307787, 0, 0.4226182617), y=(0.1093816549, 0.9659258263, -0.234569716)), Plane(origin=(2363.266597, -16.61425395, 203.2792277), x=(0.906307787, 0, 0.4226182617), y=(0.1093816549, 0.9659258263, -0.234569716))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], {0;0;3;0}: [Plane(origin=(2361.978186, -38.06163311, 311.7025856), x=(0.906307787, 0, 0.4226182617), y=(0.1093816549, 0.9659258263, -0.234569716)), Plane(origin=(2361.978186, -38.06163311, 211.7025856), x=(0.906307787, 0, 0.4226182617), y=(0.1093816549, 0.9659258263, -0.234569716)), Plane(origin=(2361.139984, -37.67298321, 211.0151992), x=(0.906307787, 0, 0.4226182617), y=(0.1093816549, 0.9659258263, -0.234569716)), Plane(origin=(2360.301166, -37.27873759, 210.3317951), x=(0.906307787, 0, 0.4226182617), y=(0.1093816549, 0.9659258263, -0.234569716)), Plane(origin=(2359.450349, -36.89557248, 209.656962), x=(0.906307787, 0, 0.4226182617), y=(0.1093816549, 0.9659258263, -0.234569716)), Plane(origin=(2358.595159, -36.50608792, 208.9913192), x=(0.906307787, 0, 0.4226182617), y=(0.1093816549, 0.9659258263, -0.234569716))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], {0;0;4;0}: [Plane(origin=(2358.390525, -52.90429514, 311.9243678), x=(0.906307787, 0, 0.4226182617), y=(0.1093816549, 0.9659258263, -0.234569716)), Plane(origin=(2358.390525, -52.90429514, 211.9243678), x=(0.906307787, 0, 0.4226182617), y=(0.1093816549, 0.9659258263, -0.234569716)), Plane(origin=(2357.57587, -52.79687106, 211.2904774), x=(0.906307787, 0, 0.4226182617), y=(0.1093816549, 0.9659258263, -0.234569716)), Plane(origin=(2356.755583, -52.67037096, 210.6674378), x=(0.906307787, 0, 0.4226182617), y=(0.1093816549, 0.9659258263, -0.234569716)), Plane(origin=(2355.931056, -52.55144556, 210.0485122), x=(0.906307787, 0, 0.4226182617), y=(0.1093816549, 0.9659258263, -0.234569716)), Plane(origin=(2355.106063, -52.42603201, 209.4315221), x=(0.906307787, 0, 0.4226182617), y=(0.1093816549, 0.9659258263, -0.234569716))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], {0;0;5;0}: [Plane(origin=(2335.83853, -104.571196, 306.483102), x=(0.906307787, 0, 0.4226182617), y=(0.1093816549, 0.9659258263, -0.234569716)), Plane(origin=(2335.83853, -104.571196, 206.483102), x=(0.906307787, 0, 0.4226182617), y=(0.1093816549, 0.9659258263, -0.234569716)), Plane(origin=(2336.047769, -103.2181814, 206.1645064), x=(0.906307787, 0, 0.4226182617), y=(0.1093816549, 0.9659258263, -0.234569716)), Plane(origin=(2336.238799, -101.8626749, 205.8451431), x=(0.906307787, 0, 0.4226182617), y=(0.1093816549, 0.9659258263, -0.234569716)), Plane(origin=(2336.436427, -100.5062651, 205.5336838), x=(0.906307787, 0, 0.4226182617), y=(0.1093816549, 0.9659258263, -0.234569716)), Plane(origin=(2336.645682, -99.15199121, 205.2205031), x=(0.906307787, 0, 0.4226182617), y=(0.1093816549, 0.9659258263, -0.234569716))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], {0;0;6;0}: [Plane(origin=(2366.428862, -1.564518079, 293.9881816), x=(0.906307787, 0, 0.4226182617), y=(0.1786061952, 0.906307787, -0.3830222216)), Plane(origin=(2366.428862, -1.564518079, 193.9881816), x=(0.906307787, 0, 0.4226182617), y=(0.1786061952, 0.906307787, -0.3830222216)), Plane(origin=(2367.482669, -1.048256136, 194.1873136), x=(0.906307787, 0, 0.4226182617), y=(0.1786061952, 0.906307787, -0.3830222216)), Plane(origin=(2368.541201, -0.5348145736, 194.3674086), x=(0.906307787, 0, 0.4226182617), y=(0.1786061952, 0.906307787, -0.3830222216)), Plane(origin=(2369.601045, -0.0168828819, 194.5260865), x=(0.906307787, 0, 0.4226182617), y=(0.1786061952, 0.906307787, -0.3830222216)), Plane(origin=(2370.66441, 0.4955862729, 194.6787753), x=(0.906307787, 0, 0.4226182617), y=(0.1786061952, 0.906307787, -0.3830222216))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]))

# ----
# Curve 1 - adjust planes
# Curve 3 - adjust planes
# Curve 7 - adjust planes
# Curve 3 - adjust planes
polyline = PolyLine(Vertices=data, Closed=False)
speed = Slider(100, range=0..100)
zone = Slider(2, range=0..100)
list_2 = ValueList({"Joint", "Linear"}, selected="Joint")
create_target = CreateTarget(Joints=degrees_to_radians, Tool=tool.Tool, Speed=speed, Zone=zone, IsCartesian=False)
create_target_2 = CreateTarget(Plane=data, Motion=list_2, Tool=tool.Tool, Speed=speed, Zone=zone, IsCartesian=True)
path_mapper = PathMapper(create_target, source="{A}", target="{A;0}")
flatten_tree = FlattenTree(Tree=create_target_2, Path="{0}")
kinematics = Kinematics(RobotSystem=load_robot_system, Target=graft(path_mapper), DisplayGeometry=False)  # -> Meshes, Joints, Planes, Errors

merge_3 = Merge(Data1=path_mapper, Data2=create_target_2)  # -> flatten(Result)
create_program = CreateProgram(Name="DefaultProgram", RobotSystem=load_robot_system, Targets=merge_3, StepSize=1)  # -> Program, Code, Duration, Warnings, Errors
program_simulation = ProgramSimulation(Program=create_program.Program, Time=Slider(0.0962, range=0..1), Normalized=True)  # -> SystemMeshes, JointRotations, Plane, Index, Time, Program, Errors
panel_2 = Panel(create_program.Warnings)
panel_3 = Panel(create_program.Errors)
simple_trail = SimpleTrail(Program=program_simulation.Program, Length=Slider(5000, range=0..10000), MechanicalGroup=0)
degrees = Degrees(Radians=program_simulation.JointRotations)
panel_4 = Panel(program_simulation.JointRotations)
panel_5 = Panel(degrees)
custom_preview = CustomPreview(
    Geometry=simple_trail,
    Material={diffuse=RGB(221, 160, 221), emission=RGB(66, 48, 66), shine=0.5, specular=RGB(255, 255, 255), transparency=0})

kinematics_2 = Kinematics(RobotSystem=load_robot_system, Target=graft(flatten_tree), DisplayGeometry=False)  # -> Meshes, Joints, Planes, Errors
text_split = TextSplit(Text=kinematics.Joints, Separators=",")
text_split_2 = TextSplit(Text=kinematics_2.Joints, Separators=",")
degrees_2 = Degrees(Radians=text_split)
degrees_3 = Degrees(Radians=text_split_2)
list_item = ListItem(List=degrees_3, Index=0, Wrap=True)  # -> Item, Item1, Item2, Item3, Item4, Item5
expression = Expression(x=list_item.Item1, Expression="(x-90)*-1")
# Curve x - adjust planes
# Curve 3 - adjust planes
panel_6 = Panel("} ADVANCE")
expression_2 = Expression(x=list_item.Item, Expression="x*-1")
expression_3 = Expression(x=list_item.Item2, Expression="x-90")
expression_4 = Expression(x=list_item.Item3, Expression="x*-1")
expression_5 = Expression(x=list_item.Item4, Expression="x*-1")
expression_6 = Expression(x=list_item.Item5, Expression="x*-1")
list_item_2 = ListItem(List=degrees_2, Index=0, Wrap=True)  # -> Item, Item1, Item2, Item3, Item4, Item5
expression_7 = Expression(x=list_item_2.Item1, Expression="(x-90)*-1")
expression_8 = Expression(x=list_item_2.Item5, Expression="x*-1")
expression_9 = Expression(x=list_item_2.Item, Expression="x*-1")
expression_10 = Expression(x=list_item_2.Item2, Expression="x-90")
expression_11 = Expression(x=list_item_2.Item3, Expression="x*-1")
expression_12 = Expression(x=list_item_2.Item4, Expression="x*-1")
concatenate = Concatenate(
    F="MOVEFLY LINEAR TO{",
    _1=expression_2,
    A=",",
    _2=expression,
    B=",",
    _3=expression_3,
    C=",",
    _4=expression_4,
    D=",",
    _5=expression_5,
    E=",",
    _6=expression_6,
    G=panel_6)  # -> flatten(Result)
merge_4 = Merge(Data1=expression_2, Data2=expression, Data3=expression_3, Data4=expression_4, Data5=expression_5, Data6=expression_6)
panel_7 = Panel(merge_4)
list_item_3 = ListItem(List=concatenate, Index=0, Wrap=True)
concatenate_2 = Concatenate(
    F="MOVE LINEAR TO{",
    _1=expression_9,
    A=",",
    _2=expression_7,
    B=",",
    _3=expression_10,
    C=",",
    _4=expression_11,
    D=",",
    _5=expression_12,
    E=",",
    _6=expression_8,
    G="}")  # -> flatten(Result)
# Curve 7 - adjust planes
# Curve 2,3,4,5 - adjust planes
# Curve x - adjust planes
# Curve 0,3,4 - adjust planes
panel_8 = Panel("MOVE")
replace_text = ReplaceText(Text=list_item_3, Find="ADVANCE", RecursiveReplace=False)
replace_text_2 = ReplaceText(Text=replace_text, Find="MOVEFLY", Replace=panel_8, RecursiveReplace=False)
insert_items = InsertItems(List=concatenate_2, Item="$ARM_OVR := 50", Indices="0", Wrap=True)
replace_items = ReplaceItems(List=concatenate, Item=replace_text_2, Indices="0", Wrap=False)
suirify = Suirify(insert_items)
unflatten_tree = UnflattenTree(Tree=replace_items, Guide=create_target_2)
list_item_4 = ListItem(List=unflatten_tree, Index=0, Wrap=True)  # -> Item1, Item
replace_text_3 = ReplaceText(Text=list_item_4.Item1, Find="ADVANCE", RecursiveReplace=False)
replace_text_4 = ReplaceText(Text=replace_text_3, Find="MOVEFLY", Replace=panel_8, RecursiveReplace=False)
list_length = ListLength(List=unflatten_tree)  # -> expr("x-1", Length)
replace_items_2 = ReplaceItems(List=unflatten_tree, Item=replace_text_4, Indices=list_length, Wrap=False)
simplify_tree = SimplifyTree(Tree=replace_items_2, Front=False)
panel_9 = Panel("""$ARM_OVR := 100
arc_job(50)
arc_start(2)""")
insert_items_2 = InsertItems(List=simplify_tree, Item="$ARM_OVR := 50", Indices="1", Wrap=True)
insert_items_3 = InsertItems(List=insert_items_2, Item=panel_9, Indices="3", Wrap=True)
list_item_5 = ListItem(List=insert_items_3, Index="2", Wrap=True)
program_name = Panel("PROGRAM_NAME")
replace_text_5 = ReplaceText(Text=list_item_5, Find="MOVEFLY", Replace="MOVE", RecursiveReplace=False)
header = Panel("""PROGRAM PROGRAM_NAME EZ, PROG_ARM = 1, STACK = 2048	--the name of the program must be the at beginning and end and the filename
VAR Lot, Ursprung, p000, p1000, p0, p1, p2, p3, p4, p5, p6, p7, p8, p9, p10 : POSITION
  l, lmax, n, i, q, o, s, t, u, v : INTEGER
  h, h1, h2, h3, h4, h5, x0, y0, z0, a0, e0, r0, r, z1, w, d, d1, d2, d3, dx, dz, x1, x : REAL		--defined variables
  punkt : ARRAY[5] OF POSITION
  opt : STRING[20]	--dont know 
--  
ROUTINE a_frame(ai_f_num : INTEGER) EXPORTED FROM tu_frame	--robot and welding routines, always need to stand there like this
ROUTINE arc_job(ai_njob : INTEGER) EXPORTED FROM wa_appl
ROUTINE arc_init EXPORTED FROM wa_appl
ROUTINE arc_end(ai_ntbl : INTEGER) EXPORTED FROM wa_appl
ROUTINE arc_start(ai_ntbl : INTEGER) EXPORTED FROM wa_appl
ROUTINE a_tool(ai_t_idx : INTEGER) EXPORTED FROM TT_TOOL
--
--  
ROUTINE cool_BREAK EXPORTED FROM PROGRAM_NAME	--the name after "from..." must fit the name of the program
ROUTINE cool_ON EXPORTED FROM PROGRAM_NAME
ROUTINE cool_OFF EXPORTED FROM PROGRAM_NAME
-- 
--
ROUTINE cool_ON   --K++HLEN AN	--start permanent cooling
BEGIN
  $DOUT[101] := ON
  --$DOUT[102]:= ON
END cool_ON
-- 
--
ROUTINE cool_OFF   --K++HLEN AUS	--stop permanent cooling
BEGIN
  $DOUT[101] := OFF
  --$DOUT[102]:= OFF
END cool_OFF
--
--
ROUTINE cool_BREAK   --cooling break 
BEGIN
  --$DOUT[101] := ON
  $DOUT[102] := ON
  DELAY 30000		-- cooling time
  --$DOUT[101] := OFF
  $DOUT[102] := OFF
END cool_BREAK
--
-- 
BEGIN		-- start of the program itself
  --
  a_frame(num)   --initializing Uframe
  a_tool(15)	--initializing tool
  arc_init
  --  
  -- LOT teachen		-- this is just if we teach UFrame manually
  --MOVE LINEAR TO Lot
  --Ursprung teachen
  --MOVE LINEAR TO Ursprung
  --POS_XTRT(Ursprung, x0, y0, z0, a0, e0, r0, opt)
  --  
  --$FLY_TYPE := HIGH (GEHT NICHT)
  --$FLY_TYPE := FLY_CART
	--do routine point_update
  --  
  z1 := 100	--to make it easy to move to start point with z1 as delta to z-coordinate
  --  
  $ARM_OVR := 50
  -- SAFETY_INITIAL_POINT_1
  --  SAFETY_INITIAL_POINT_2
  --  SAFETY_INITIAL_POINT_3
  --
  --Start the code with the coordinates
  --""")
replace_text_6 = ReplaceText(Text=replace_text_5, Find="ADVANCE", RecursiveReplace=False)
panel_10 = Panel("""arc_end(1)
MOVE LINEAR RELATIVE VEC(0,0,30) IN TOOL
DELAY 3000
MOVE LINEAR RELATIVE VEC(0,0,100) IN TOOL
WAIT FOR $FDIN[21]""")
replace_items_3 = ReplaceItems(List=insert_items_3, Item=replace_text_6, Indices="2", Wrap=False)
list_length_2 = ListLength(List=insert_items_3)
insert_items_4 = InsertItems(List=replace_items_3, Item=panel_10, Indices=list_length_2, Wrap=True)  # -> simplify(List)
data_2 = Data(program_name)
panel_11 = Panel("8")
base_frame = Panel("0")
path_mapper_2 = PathMapper(insert_items_4, source="{A}", target="{0;A+1}")
tree_statistics = TreeStatistics(Tree=path_mapper_2)  # -> Paths, Length, expr("x+1", flatten(Count))
concatenate_3 = Concatenate(Fragment_A="END ", Fragment_B=data_2, A="--end the welding program")
concatenate_4 = Concatenate(FragmentA="a_frame(", FragmentB=base_frame, FragmentA_2=")")
construct_path = ConstructPath(Indices=simplify([tree_statistics.Count, Slider(0, range=0..100)]))
text = Text(header)
replace_text_7 = ReplaceText(Text=text, Find="a_frame(num)", Replace=concatenate_4, RecursiveReplace=False)
panel_12 = Panel("""DELAY 0
-- cooling time""")
text_2 = Text(concatenate_3)
replace_paths = ReplacePaths(Data=text_2, Search="{0}", Replace=construct_path)
replace_text_8 = ReplaceText(Text=replace_text_7, Find="DELAY 30000\t\t-- cooling time", Replace=panel_12, RecursiveReplace=False)
panel_13 = Panel(replace_paths)
merge_5 = Merge(Data1=insert_items, Data2=path_mapper_2)
text_3 = Text(replace_text_8)
replace_text_9 = ReplaceText(Text=text_3, PROGRAM_NAME="PROGRAM_NAME", Replace=data_2, RecursiveReplace=False)  # -> simplify(Result)
path_mapper_3 = PathMapper(merge_5, source="{A;B}", target="{A;B+1}")
path_mapper_4 = PathMapper(replace_text_9, source="{A}", target="{0;0}")
merge_6 = Merge(Data1=path_mapper_4, Data2=path_mapper_3, Data3=replace_paths)
panel_14 = Panel("C:\")
txt = Text(flatten(merge_6))
path = FilePath("E:\test1picknplace_01.prg")
python = GhPythonScript(program=txt, path=path, write=Button())  # -> out, a; inputs program: list
# ---------- python: Python ----------
import rhinoscriptsyntax as rs


if write:
    with open(path + name + '.pdl', 'w') as file:
        for line in program:
            file.write(line)
            file.write('\n')
# ---------- end python ----------
panel_15 = Panel(merge_6)
